# Grasshopper definition UnityReceiver.gh (Grasshopper 1.0.7)

init = Button()
c_script = CSharpScript(init=init)  # -> Data, Position, Rotation; inputs init: Boolean
# ---------- c_script: C# usings ----------
using Grasshopper.Kernel.Special;
using Grasshopper.GUI.Canvas;
# ---------- c_script: C# ----------
    if(forceUpdate || init)
    {
      using(var args = new Rhino.Runtime.NamedParametersEventArgs())
      {
        Component.PingDocument -= OnPingDocument;
        Component.PingDocument += OnPingDocument;
        Component.ObjectChanged -= OnObjectChanged;
        Component.ObjectChanged += OnObjectChanged;
        Grasshopper.Instances.ActiveCanvas.DocumentChanged -= OnDocumentChanged;
        Grasshopper.Instances.ActiveCanvas.DocumentChanged += OnDocumentChanged;

        args.Set("id", Component.InstanceGuid.ToString());
        args.Set("data", dataValue);
        Rhino.Runtime.HostUtils.ExecuteNamedCallback("FromGHClearUI", args);
        Rhino.Runtime.HostUtils.ExecuteNamedCallback("FromGHData", args);

        Register(Component);
      }

      forceUpdate = false;
    }

    Data = dataValue;
    Position = posValue;
    Rotation = rotValue;
# ---------- c_script: C# additional code ----------
  string dataValue = "";
  Vector3d posValue;
  Vector3d rotValue;

  IGH_Component comp = null;

  bool forceUpdate = false;

  void Register(IGH_Component component)
  {
    Rhino.Runtime.HostUtils.RegisterNamedCallback("ToGH_Data_" + Component.InstanceGuid.ToString(), ToGrasshopper);
    Rhino.Runtime.HostUtils.RegisterNamedCallback("ToGH_Position_" + Component.InstanceGuid.ToString(), ToGrasshopper);
    Rhino.Runtime.HostUtils.RegisterNamedCallback("ToGH_Rotation_" + Component.InstanceGuid.ToString(), ToGrasshopper);

    comp = component;
  }

  void ToGrasshopper(object sender, Rhino.Runtime.NamedParametersEventArgs args)
  {
    string data;
    Vector3d position;
    Vector3d rotation;

    if (args.TryGetString("data", out data))
    {
      dataValue = data;
    }
    if (args.TryGetVector("position", out position))
    {
      posValue = position;
    }
    if (args.TryGetVector("rotation", out rotation))
    {
      rotValue = rotation;
    }

    comp.ExpireSolution(true);
  }

  public void OnPingDocument(object sender, GH_PingDocumentEventArgs e){
    if(e.Document == null){
      using(var args = new Rhino.Runtime.NamedParametersEventArgs()){
        args.Set("id", comp.InstanceGuid.ToString());
        Rhino.Runtime.HostUtils.ExecuteNamedCallback("FromGHClearUI", args);
      }
    }
  }

  public void OnObjectChanged(object sender, GH_ObjectChangedEventArgs e){
    if(e.Type == GH_ObjectEventType.Enabled){
      if(comp.Locked){
        using(var args = new Rhino.Runtime.NamedParametersEventArgs()){
          forceUpdate = true;
          args.Set("id", comp.InstanceGuid.ToString());
          Rhino.Runtime.HostUtils.ExecuteNamedCallback("FromGHClearUI", args);
        }
      }
    }

    comp.ExpireSolution(true);
  }

  public void OnDocumentChanged(object sender, GH_CanvasDocumentChangedEventArgs e){
    using(var args = new Rhino.Runtime.NamedParametersEventArgs()){
      args.Set("id", comp.InstanceGuid.ToString());
      Rhino.Runtime.HostUtils.ExecuteNamedCallback("FromGHClearUI", args);

      forceUpdate = true;

      if(comp != null){
        comp.ExpireSolution(true);
      }
    }
  }
# ---------- end c_script ----------
panel = Panel(c_script.Data)
panel_2 = Panel(c_script.Rotation)
panel_3 = Panel(c_script.Position)
